# Grasshopper definition visualization.gh (Grasshopper 1.0.7)

opaquematnomass = HBOpaqueMaterialNoMass(name="Int. Sur Coeff", r_value="0.121", therm_absp="0.9", sol_absp="0.6", vis_absp="0.6")  # -> mat; plug-in component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
opaquematnomass_2 = HBOpaqueMaterialNoMass(name="Ext. Sur Coeff", r_value="0.034", therm_absp="0.9", sol_absp="0.6", vis_absp="0.6")  # -> mat; plug-in component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
opaquemat = HBOpaqueMaterial(name="Plasterboard", thickness="0.012", conductivity="0.16", density="950", spec_heat="840")  # -> mat; plug-in component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
opaquemat_2 = HBOpaqueMaterial(name="Wood Siding", thickness="0.009", conductivity="0.14", density="530", spec_heat="900")  # -> mat; plug-in component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
opaquemat_3 = HBOpaqueMaterial(name="Fiberglass Quilt", thickness="0.066", conductivity="0.04", density="12", spec_heat="840")  # -> mat; plug-in component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
opaquematnomass_3 = HBOpaqueMaterialNoMass(name="Int. Sur Coeff-roof", r_value="0.121", therm_absp="0.9", sol_absp="0.6", vis_absp="0.6")  # -> mat; plug-in component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
opaquematnomass_4 = HBOpaqueMaterialNoMass(name="Ext. Sur Coeff", r_value="0.034", therm_absp="0.9", sol_absp="0.6", vis_absp="0.6")  # -> mat; plug-in component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
opaquemat_4 = HBOpaqueMaterial(name="Plasterboard-roof", thickness="0.01", conductivity="0.16", density="950", spec_heat="840")  # -> mat; plug-in component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
opaquemat_5 = HBOpaqueMaterial(name="Roof Deck", thickness="0.019", conductivity="0.14", density="530", spec_heat="900")  # -> mat; plug-in component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
opaquemat_6 = HBOpaqueMaterial(name="Fiberglass Quilt-roof", thickness="0.1118", conductivity="0.04", density="12", spec_heat="840")  # -> mat; plug-in component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
opaquematnomass_5 = HBOpaqueMaterialNoMass(name="Int. Sur Coeff-floor", r_value="0.121")  # -> mat; plug-in component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
opaquemat_7 = HBOpaqueMaterial(name="Timber Flooring", thickness="0.025", conductivity="0.14", density="650", spec_heat="1200")  # -> mat; plug-in component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
opaquemat_8 = HBOpaqueMaterial(name="Insulation", thickness="1.003", conductivity="0.04", density="10", spec_heat="1400")  # -> mat; plug-in component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
merge = Merge(Data1=opaquemat_8, Data2=opaquemat_7, Data3=opaquematnomass_5)
merge_2 = Merge(Data1=opaquematnomass, Data2=opaquemat, Data3=opaquemat_3, Data4=opaquemat_2, Data5=opaquematnomass_2)
merge_3 = Merge(Data1=opaquematnomass_4, Data2=opaquemat_5, Data3=opaquemat_6, Data4=opaquemat_4, Data5=opaquematnomass_3)
opaqueconstr = HBOpaqueConstruction(name="wall", materials=merge_2)  # -> constr; plug-in component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
opaqueconstr_2 = HBOpaqueConstruction(name="roof", materials=merge_3)  # -> constr; plug-in component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
opaqueconstr_3 = HBOpaqueConstruction(name="Floor", materials=merge)  # -> constr; plug-in component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
decnstrmat = HBDeconstructMaterial(mat=opaqueconstr_2)  # -> values, attr_names, r_val_si, r_val_ip; plug-in component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
decnstrmat_2 = HBDeconstructMaterial(mat=opaqueconstr)  # -> values, attr_names, r_val_si, r_val_ip; plug-in component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
decnstrmat_3 = HBDeconstructMaterial(mat=opaqueconstr_3)  # -> values, attr_names, r_val_si, r_val_ip; plug-in component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
panel = Panel(decnstrmat_3.r_val_si)
panel_2 = Panel(decnstrmat_2.r_val_si)
panel_3 = Panel(decnstrmat.r_val_si)
exteriorsubset = HBExteriorConstructionSubset(exterior_wall=opaqueconstr, exterior_roof=opaqueconstr_2)  # -> exterior_set; plug-in component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
groundsubset = HBGroundConstructionSubset(ground_floor=opaqueconstr_3)  # -> ground_set; plug-in component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
constructionset = HBConstructionSet(exterior_subset=exteriorsubset, ground_subset=groundsubset)  # -> constr_set; plug-in component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

panel_4 = Panel("AIR")
glassmat = HBGlassMaterial(
    name="glass",
    thickness="0.003175",
    transmittance="0.86156",
    reflectance="0.07846",
    t_infrared="0",
    emiss_front="0.84",
    emiss_back="0.84",
    conductivity="1.06")  # -> mat; plug-in component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
glassmat_2 = HBGlassMaterial(
    name="glass",
    thickness="0.003175",
    transmittance="0.86156",
    reflectance="0.07846",
    t_infrared="0",
    emiss_front="0.84",
    emiss_back="0.84",
    conductivity="1.06")  # -> mat; plug-in component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
gapmat = HBWindowGapMaterial(name="air", thickness="0.013")  # -> mat; plug-in component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
merge_4 = Merge(Data1=glassmat_2, Data2=gapmat, Data3=glassmat)
windowconstr = HBWindowConstruction(name="window", materials=merge_4)  # -> constr; plug-in component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
decnstrmat_4 = HBDeconstructMaterial(mat=windowconstr)  # -> values, attr_names, r_val_si, r_val_ip; plug-in component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
panel_5 = Panel(decnstrmat_4.r_val_si)

panel_6 = Panel("C:\Users\mucd7\OneDrive - University of Missouri\Desktop\Rhino\Own\EP-BESTEST.epw")
importepw = LBImportEPW(epw_file=panel_6)  # -> location, dry_bulb_temperature, dew_point_temperature, relative_humidity, wind_speed, wind_direction, direct_normal_rad, diffuse_horizontal_rad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; plug-in component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
boolean_toggle = BooleanToggle(True)
createepw = DFCreateEPW(
    location=importepw.location,
    dry_bulb_temp=importepw.dry_bulb_temperature,
    dew_point_temp=importepw.dew_point_temperature,
    wind_speed=importepw.wind_speed,
    wind_direction=importepw.wind_direction,
    direct_normal_rad=importepw.direct_normal_rad,
    diffuse_horiz_rad=importepw.diffuse_horizontal_rad,
    direct_normal_ill=importepw.direct_normal_ill,
    diffuse_horiz_ill=importepw.diffuse_horizontal_ill,
    total_sky_cover=importepw.total_sky_cover,
    atmos_pressure=importepw.barometric_pressure,
    model_year=importepw.model_year,
    base_epw=panel_6,
    run=boolean_toggle)  # -> report, epw_obj; plug-in component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
panel_7 = Panel("C:\Users\mucd7\OneDrive - University of Missouri\Desktop\Rhino\Own")
writeepw = DFWriteEPW(epw_obj=createepw.epw_obj, folder=panel_7, file_name="DRYCOLD_denver", run=boolean_toggle)  # -> report, epw_file; plug-in component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

win_wall_west = Slider(0.8, range=0.2..0.8)
win_wall_north = Slider(0.2, range=0.2..0.8)
win_wall_south = Slider(0.8, range=0.2..0.8)
win_wall_east = Slider(-0.2, range=-0.2..0.8)
southwall_area = Multiplication(A="8", B="2.7")
window_wall = Division(A="12", B=southwall_area)
panel_8 = Panel(window_wall)
facparam = HBFacadeParameters(north=0, east=0, south=panel_8, west=0)  # -> fac_par; plug-in component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
aperturesbyratio = HBAperturesByRatio(ratio=panel_8, subdivide=Toggle(False))  # -> report, hb_objs; plug-in component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
panel_9 = Panel("""88.831
142.824
36.516""")

# ---- group: Programme
constantschedule = HBConstantSchedule(values="27", type_limit="Temperature")  # -> report, schedule, idf_text; plug-in component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
constantschedule_2 = HBConstantSchedule(values="20", type_limit="Temperature")  # -> report, schedule, idf_text; plug-in component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
ach = Panel("0.5")
m3 = Panel("129.6")
s = Panel("3600")
multiplication = Multiplication(A=m3, B=ach)
division = Division(A=multiplication, B=s)
facade_area = Panel("75.6")
constantschedule_3 = HBConstantSchedule(values="1")  # -> report, schedule, idf_text; plug-in component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
setpoint = HBSetpoint(heating_sch=constantschedule_2.schedule, cooling_sch=constantschedule.schedule)  # -> setpoint; plug-in component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
m3_s_m2 = Division(A=division, B=facade_area)
division_2 = Division(A="200", B="48")
infiltration = HBInfiltration(flow_per_ext_area=m3_s_m2)  # -> infil; plug-in component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
panel_10 = Panel(constantschedule_3.schedule)
equipment = HBEquipment(watts_per_area=division_2, schedule=constantschedule_3.schedule, radiant_fract="0.6")  # -> equip; plug-in component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

# ---- group: Not in Case 600
people = HBPeople(ppl_per_area="0.2", occupancy_sch=constantschedule_3.schedule)  # -> people; plug-in component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

# ---- group: Programme (continued)
programtype = HBProgramType(people=people, electric_equip=equipment, infiltration=infiltration, setpoint=setpoint)  # -> program; plug-in component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

# ---- group: Geometry
room = Brep(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)
windows = Brep([<brep referenced from the Rhino model> x2])
roomsolid = HBRoomFromSolid(geo=flatten(room), name="Room_1", constr_set=constructionset, program=programtype, conditioned=Toggle(True))  # -> report, rooms; plug-in component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
aperture = HBAperture(geo=windows, ep_constr=windowconstr)  # -> report, apertures; plug-in component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

# ----
# https://climate.onebuilding.org/WMO_Region_4_North_and_Central_America/USA_United_States_of_America/CO_Colorado/USA_CO_Denver.Intl.AP.725650_TMY3.zip
panel_11 = Panel("https://climate.onebuilding.org/WMO_Region_4_North_and_Central_America/USA_United_States_of_America/CO_Colorado/USA_CO_Denver-Lowry.AFB.724691_TMYx.zip")
addsubface = HBAddSubface(hb_obj=flatten(roomsolid.rooms), sub_faces=flatten(aperture.apertures))  # -> hb_obj; plug-in component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
idealair = HBIdealAir(rooms=flatten(addsubface), economizer="NoEconomizer")  # -> report, rooms; plug-in component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
downloadepw = LBDownloadWeather(weather_URL=panel_11)  # -> epw_file, stat_file, ddy_file; plug-in component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
panel_12 = Panel("Sensible")
simoutput = HBSimulationOutput()  # -> report, sim_output; plug-in component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
panel_13 = Panel("""Site:GroundTemperature:BuildingSurface,
    10,                      !- January Ground Temperature {C}
    10,                      !- February Ground Temperature {C}
    10,                      !- March Ground Temperature {C}
    10,                      !- April Ground Temperature {C}
    10,                      !- May Ground Temperature {C}
    10,                      !- June Ground Temperature {C}
    10,                      !- July Ground Temperature {C}
    10,                      !- August Ground Temperature {C}
    10,                      !- September Ground Temperature {C}
    10,                      !- October Ground Temperature {C}
    10,                      !- November Ground Temperature {C}
    10;                      !- December Ground Temperature {C}""")
model = HBModel(rooms=flatten(idealair.rooms), name="Case 600")  # -> report, model; plug-in component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
simpar = HBSimulationParameter(output=simoutput.sim_output, timestep="20")  # -> sim_par; plug-in component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
vizbytype = HBVisualizeByType(hb_objs=model.model)  # -> walls, interior_walls, roofs, ceilings, exterior_floors, interior_floors, air_walls, apertures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; plug-in component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
boolean_toggle_2 = BooleanToggle(False)
modeltoosm = HBModelToOSM(
    model=model.model,
    epw_file=downloadepw.epw_file,
    sim_par=simpar,
    add_str=panel_13,
    write=boolean_toggle_2,
    run=boolean_toggle_2)  # -> report, jsons, osw, osm, idf, sql, zsz, rdd, html; plug-in component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
geo = Geometry(vizbytype.wire_frame)
boolean_toggle_3 = BooleanToggle(False)
eui = HBEndUseIntensity(sql=modeltoosm.sql)  # -> eui, eui_end_use, end_uses, gross_floor; plug-in component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
peakloads = HBPeakLoads(rooms=idealair.rooms, ddy_file=downloadepw.ddy_file, timestep="20", run_bal=boolean_toggle_3, run=boolean_toggle_3)  # -> out, peak_cool, peak_heat, cooling, heating, cool_bal, heat_bal; plug-in component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
panel_14 = Panel(eui.eui_end_use)
panel_15 = Panel(eui.gross_floor)
peak_load_w = Panel([peakloads.peak_cool, peakloads.peak_heat])
list_item = ListItem(List=panel_14, Index="0", Wrap=True)
list_item_2 = ListItem(List=panel_14, Index="1", Wrap=True)
multiplication_2 = Multiplication(A=list_item, B=panel_15)
multiplication_3 = Multiplication(A=list_item_2, B=panel_15)
cooling_eui = Panel(list_item_2)
cooling = Panel(multiplication_3)
heating = Panel(multiplication_2)

panel_16 = Panel("https://climate.onebuilding.org/WMO_Region_4_North_and_Central_America/USA_United_States_of_America/CO_Colorado/USA_CO_Denver-Lowry.AFB.724691_TMYx.zip")
downloadepw_2 = LBDownloadWeather(weather_URL=panel_16)  # -> epw_file, stat_file, ddy_file; plug-in component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
importddy = LBImportDDY(ddy_file=downloadepw_2.ddy_file)  # -> location, design_days; plug-in component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
decnstrdesignday = LBDeconstructDesignDay(design_day=importddy.design_days)  # -> name, day_type, location, date, dry_bulb_max, dry_bulb_range, humidity_type, humidity_value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; plug-in component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
panel_17 = Panel(decnstrdesignday.date)
panel_18 = Panel(decnstrdesignday.day_type)
panel_19 = Panel("""Site:GroundTemperature:BuildingSurface,
    10,                      !- January Ground Temperature {C}
    10,                      !- February Ground Temperature {C}
    10,                      !- March Ground Temperature {C}
    10,                      !- April Ground Temperature {C}
    10,                      !- May Ground Temperature {C}
    10,                      !- June Ground Temperature {C}
    10,                      !- July Ground Temperature {C}
    10,                      !- August Ground Temperature {C}
    10,                      !- September Ground Temperature {C}
    10,                      !- October Ground Temperature {C}
    10,                      !- November Ground Temperature {C}
    10;                      !- December Ground Temperature {C}""")
gridrooms = HBSensorGridFromRooms(rooms=roomsolid.rooms, grid_size=Slider(0.5, range=0..1))  # -> grid, points, mesh; plug-in component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
analysisperiod = LBAnalysisPeriod(
    start_month=Slider(6, range=1..12),
    start_day=Slider(21, range=1..31),
    start_hour=Slider(0, range=0..23),
    end_month=Slider(6, range=1..12),
    end_day=Slider(21, range=1..31),
    end_hour=Slider(23, range=0..23))  # -> period, hoys, dates; plug-in component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
assigngridsviews = HBAssignGridsAndViews(model=model.model, grids=flatten(gridrooms.grid))  # -> model; plug-in component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
pmvmap = HBPMVComfortMap(
    model=assigngridsviews,
    epw=downloadepw_2.epw_file,
    ddy=downloadepw_2.ddy_file,
    run_period=analysisperiod.period,
    add_str=panel_19,
    run=Toggle(False))  # -> report, env_conds, temperature, condition, pmv, TCP, HSP, CSP; plug-in component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
panel_20 = Panel(pmvmap.env_conds)
panel_21 = Panel(pmvmap.pmv)
envmtx = HBReadEnvironmentMatrix(env_conds=pmvmap.env_conds, metric=Slider(0, range=0..4), load=Toggle(True))  # -> comf_mtx; plug-in component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
oper_temp = Panel("C:\Users\mucd7\simulation\Case_600\pmv_comfort_map\results\temperature\Room_1.csv")
pmv = Panel("C:\Users\mucd7\simulation\Case_600\pmv_comfort_map\results\condition_intensity\Room_1.csv")
air_temp_c = Panel("C:\Users\mucd7\simulation\Case_600\pmv_comfort_map\initial_results\conditions\air_temperature\0.csv")
mrt_f = Panel("C:\Users\mucd7\simulation\Case_600\pmv_comfort_map\initial_results\conditions\final\mrt\Room_1.csv")
legendpar = LBLegendParameters(
    min=Slider(20, range=0..100),
    max=Slider(35, range=0..100),
    seg_count=Slider(11, range=0..100),
    num_decimals=Slider(0, range=0..100))  # -> leg_par; plug-in component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
file = ReadFile(F=mrt_f, PerLineParse=True)  # -> C
#   port F: Uri of file to read
# ---------- file: VB line parser ----------
    action = GH_LineParserAction.Include
    Return line

    'Parse the line and return some data that represents the line.
    'If the line cannot be parsed, you can return Nothing and
    'assign a different action.
    'The default implementation is to just return the line itself.
    'If you return types that implement IGH_Goo, this component
    'will work substantially faster.
# ---------- end file ----------
vizthermalmap = HBVisualizeThermalMap(comf_mtx=envmtx, mesh=flatten(gridrooms.mesh), legend_par=legendpar)  # -> report, mesh, legend, title, colors, values; plug-in component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
split = TextSplit(Text=file, Separators=",")  # -> simplify(Result)
data = Data(flatten(split))
f_to_c = GhPythonScript(F=data)  # -> out, C
# ---------- f_to_c: Python ----------
__author__ = "mucd7"
__version__ = "2024.05.12"

import rhinoscriptsyntax as r

C = (F-32)/9*5

print C
# ---------- end f_to_c ----------
geoprop = HBGeometryProperties(rooms=flatten(roomsolid.rooms))  # -> ext_wall_area, ext_win_area, volume, floor_area, floor_ep_constr; plug-in component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
minmax = GhPythonScript(temp=data)  # -> minT, maxT; inputs temp: list
# ---------- minmax: Python ----------
__author__ = "mucd7"
__version__ = "2025.05.05"

import rhinoscriptsyntax as rs
import statistics

temperature = []
for i in temp:
    temperature.append(float(i))
    
print(type(temperature))
minT = min(temperature)
maxT = max(temperature)
print(minT)
print(maxT)
# ---------- end minmax ----------
division_3 = Division(A=geoprop.volume, B=geoprop.floor_area)
panel_22 = Panel([minmax.minT, minmax.maxT])
item = ListItem(List=split, Index=Slider(17, range=0..23), Wrap=True)  # -> flatten(Item)
panel_23 = Panel(item)
stat_module2 = GhPythonScript(data=item, minT=minmax.minT, maxT=minmax.maxT, CH=division_3)  # -> out, z_axis, avg, sd; inputs data: list
# ---------- stat_module2: Python ----------
"""Provides a scripting component.
    Inputs:
        _data: The list input of variables (type: float)
    Output:
        z_score: The absolute z_score values of variable
        avg: The mean value of the variables
        std: The standard deviation of the variable
        """

__author__ = "mucd7"
__version__ = "2024.04.11"

import rhinoscriptsyntax as rs
import statistics

temperature = _data

# For air temperature, use global(24 hours) minima-maxima
#min_t = minT
#max_t = maxT
#height = CH
#
#if min_t-max_t !=0:
#    z_axis = [(x - min_t)/(max_t - min_t)*height for x in temperature]
#


# For MRT, use hourly minima-maxima
min_t = min(temperature)
max_t = max(temperature)
height = CH
if min_t-max_t !=0:
    z_axis = [(x - min_t)/(max_t - min_t)*height for x in temperature]

print(min_t)
print(max_t)
print(z_axis)
# ---------- end stat_module2 ----------
pcomp = Decompose(Point=gridrooms.points)  # -> XComponent, YComponent, ZComponent
panel_24 = Panel(stat_module2.z_axis)
old_stat_module = GhPythonScript(data=item)  # -> out, z_axis, avg, sd; inputs data: list
# ---------- old_stat_module: Python ----------
"""Provides a scripting component.
    Inputs:
        _data: The list input of variables (type: float)
    Output:
        z_score: The absolute z_score values of variable
        avg: The mean value of the variables
        std: The standard deviation of the variable
        """

__author__ = "mucd7"
__version__ = "2024.04.11"

import rhinoscriptsyntax as rs
import statistics

temperature = _data

avg = statistics.mean(temperature)
sd = statistics.stdev(temperature)

min_t = min(temperature)
max_t = max(temperature)

if min_t-max_t !=0:
    z_axis = [(x - min_t)/(max_t - min_t)*1.5 for x in temperature]
else:
    # For air temperature
    z_axis = [(x-19)/(37-19)*2 for x in temperature]
print(min(temperature))
print(max(temperature))
print(z_axis)
# ---------- end old_stat_module ----------
bnd = Bounds(Numbers=stat_module2.z_axis)
pt = ConstructPoint(XCoordinate=pcomp.XComponent, YCoordinate=pcomp.YComponent, ZCoordinate=stat_module2.z_axis)
number_slider = Slider(16, range=0..100)
dedomain = DeconstructDomain(Domain=bnd)  # -> Start, End
panel_25 = Panel(bnd)
srfgrid = SurfaceFromPoints(Points=pt, UCount=number_slider, Interpolate=False)
gradient = Gradient(
    LowerLimit=dedomain.End,
    UpperLimit=dedomain.Start,
    Parameter=stat_module2.z_axis,
    stops=[0: RGB(234, 38, 0), 0.25: RGB(234, 126, 0), 0.5: RGB(254, 244, 84), 0.75: RGB(173, 203, 249), 1: RGB(75, 107, 169)])
divide = DivideDomain²(Domain=srfgrid, UCount=number_slider, VCount="12")
subsrf = Isotrim(Surface=srfgrid, Domain=divide)
area = Area(Geometry=subsrf)  # -> Area, Centroid
preview = CustomPreview(Geometry=subsrf, Material=gradient)

getgridsviews = HBGetGridsAndViews(model=assigngridsviews)  # -> views, grids, points, meshes; plug-in component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
panel_26 = Panel(eui.end_uses)
